# Dynamo graph eyup2_model.dyn (Dynamo 2.19.3.6394)
# packages: Elk 1.1.0

# group: OSM
file_path = Filename(".\eyüp2.osm")
location = Elk.OSM.Location(filePath=file_path)

# group: OSM Natural
code_block = CodeBlock { "natural"; "tree"; }
OSMData = Elk.OSM.OSMData(OSM=location.OSM, File=location.XML, featureType=code_block.out0, subTypes=code_block.out1)

# group: Geometry Translate z coordinates
code_block_2 = CodeBlock { 100; }
translate = Geometry.Translate(geometry=OSMData.Points, zTranslation=code_block_2)

# group: Topography
file_path_2 = Filename(".\n41_e028_1arc_v3.tif")
createTopo = Elk.Topography.CreateTopo(filePath=file_path_2, location=location.Loc)
flatten = List.Flatten(list=createTopo.Points)
byPoints = Topography.ByPoints(points=flatten)

# group: Project
ZAxis = Vector.ZAxis()
reverse = Vector.Reverse(vector=ZAxis)
code_block_3 = CodeBlock(surfacetopography=createTopo.Surface) { surfacetopography; }
distanceTo = Geometry.DistanceTo(geometry=translate, other=code_block_3)
translate_2 = Geometry.Translate(geometry=translate, direction=reverse, distance=distanceTo)

# group: tree
family_types = FamilyTypes("Planting_RPC_Tree_Deciduous:Red_Ash-7.6_Meters")
byPoint = FamilyInstance.ByPoint(familyType=family_types, point=translate_2)

# group: OSM Building
code_block_4 = CodeBlock { "building"; "*"; }
OSMData_2 = Elk.OSM.OSMData(OSM=location.OSM, File=location.XML, featureType=code_block_4.out0, subTypes=code_block_4.out1)

# group: Building Footprints
pruneDuplicates = Point.PruneDuplicates(points=OSMData_2.Points)

# group: Geometry Translate z coordinates
code_block_5 = CodeBlock { 100; }
translate_3 = Geometry.Translate(geometry=pruneDuplicates, zTranslation=code_block_5)

# group: Project
code_block_6 = CodeBlock(buildingspoints=translate_3) { buildingspoints; }
ZAxis_2 = Vector.ZAxis()
reverse_2 = Vector.Reverse(vector=ZAxis_2)
code_block_7 = CodeBlock(surfacetopography=createTopo.Surface) { surfacetopography; }
distanceTo_2 = Geometry.DistanceTo(geometry=code_block_6, other=code_block_7)
maximumItem = List.MaximumItem(list=distanceTo_2)
translate_4 = Geometry.Translate(geometry=code_block_6, direction=reverse_2, distance=maximumItem)

# group: height random
count = List.Count(list=translate_3)
code_block_8 = CodeBlock { 3; 21; 3; }
randomList = Math.RandomList(amount=count, value1=code_block_8.out0, value2=code_block_8.out1, seed=code_block_8.out2)

# group: Building Solid
byPoints_2 = Polygon.ByPoints(points=translate_4)
ZAxis_3 = Vector.ZAxis()
extrudeAsSolid = Curve.ExtrudeAsSolid(curve=byPoints_2, direction=ZAxis_3, distance=randomList)

# group: Building 2 Revit
categories = Categories("OST_Mass")
code_block_9 = CodeBlock { "building"; }
byGeometry = DirectShape.ByGeometry(geometry=extrudeAsSolid, category=categories, name=code_block_9)

# group: roof
roof_types = RoofTypes("Roof_Pitched-50SS-220Ins-20MPan-225Purl")
byGeometry_2 = BoundingBox.ByGeometry(geom=extrudeAsSolid)
maxPoint = BoundingBox.MaxPoint(boundingBox=byGeometry_2)
Z = Point.Z(point=maxPoint)
byElevation = Level.ByElevation(elevation=Z)
byOutlineTypeAndLevel = Roof.ByOutlineTypeAndLevel(outline=byPoints_2, roofType=roof_types, level=byElevation)
