# Dynamo graph eyup_osm.dyn (Dynamo 2.19.3.6394)
# packages: Elk 1.1.0

# group: OSM
file_path = Filename(".\eyup.large.osm")
location = Elk.OSM.Location(filePath=file_path)

# group: OSM Natural
code_block = CodeBlock { "natural"; "tree"; }
OSMData = Elk.OSM.OSMData(OSM=location.OSM, File=location.XML, featureType=code_block.out0, subTypes=code_block.out1)

# group: Geometry Translate z coordinates
code_block_2 = CodeBlock { 100; }
translate = Geometry.Translate(geometry=OSMData.Points, zTranslation=code_block_2)

# group: Topography
file_path_2 = Filename(".\n41_e028_1arc_v3.tif")
createTopo = Elk.Topography.CreateTopo(filePath=file_path_2, location=location.Loc)
flatten = List.Flatten(list=createTopo.Points)
byPoints = Topography.ByPoints(points=flatten)
byPoints_2 = NurbsSurface.ByPoints(points=createTopo.Surface)
categories = Categories("OST_Mass")
code_block_3 = CodeBlock { "TOPO"; }
byGeometry = DirectShape.ByGeometry(geometry=byPoints_2, category=categories, name=code_block_3)

# group: Project
ZAxis = Vector.ZAxis()
reverse = Vector.Reverse(vector=ZAxis)
code_block_4 = CodeBlock(surfacetopography=createTopo.Surface) { surfacetopography; }
distanceTo = Geometry.DistanceTo(geometry=translate, other=code_block_4)
translate_2 = Geometry.Translate(geometry=translate, direction=reverse, distance=distanceTo)

# group: tree
family_types = FamilyTypes("Planting_RPC_Tree_Deciduous:Red_Ash-7.6_Meters")
byPoint = FamilyInstance.ByPoint(familyType=family_types, point=translate_2)

# group: OSM Building
code_block_5 = CodeBlock { "building"; "*"; }
OSMData_2 = Elk.OSM.OSMData(OSM=location.OSM, File=location.XML, featureType=code_block_5.out0, subTypes=code_block_5.out1)

# group: Building Footprints
pruneDuplicates = Point.PruneDuplicates(points=OSMData_2.Points)

# group: Geometry Translate z coordinates
code_block_6 = CodeBlock { 100; }
translate_3 = Geometry.Translate(geometry=pruneDuplicates, zTranslation=code_block_6)

# group: Project
code_block_7 = CodeBlock(buildingspoints=translate_3) { buildingspoints; }
ZAxis_2 = Vector.ZAxis()
reverse_2 = Vector.Reverse(vector=ZAxis_2)
code_block_8 = CodeBlock(surfacetopography=createTopo.Surface) { surfacetopography; }
distanceTo_2 = Geometry.DistanceTo(geometry=code_block_7, other=code_block_8)
maximumItem = List.MaximumItem(list=distanceTo_2)
translate_4 = Geometry.Translate(geometry=code_block_7, direction=reverse_2, distance=maximumItem)

# group: Building Heights
code_block_9 = CodeBlock(keys=OSMData_2.Keys) { keys; }
code_block_10 = CodeBlock { "height:"; }
contains = String.Contains(string=code_block_9, searchFor=code_block_10)
filterByBoolMask = List.FilterByBoolMask(list=code_block_9, mask=contains)
code_block_11 = CodeBlock { ":"; }
split = String.Split(string=filterByBoolMask.in, separator0=code_block_11)
flatten_2 = List.Flatten(list=split)
code_block_12 = CodeBlock { 2; }
takeEveryNthItem = List.TakeEveryNthItem(list=flatten_2, n=code_block_12)

# group: Building Solid
byPoints_3 = Polygon.ByPoints(points=translate_4)
ZAxis_3 = Vector.ZAxis()
toNumber = String.ToNumber(string=takeEveryNthItem)
extrudeAsSolid = Curve.ExtrudeAsSolid(curve=byPoints_3, direction=ZAxis_3, distance=toNumber)

# group: Building 2 Revit
categories_2 = Categories("OST_Mass")
code_block_13 = CodeBlock { "building"; }
byGeometry_2 = DirectShape.ByGeometry(geometry=extrudeAsSolid, category=categories_2, name=code_block_13)

# group: OSM water
code_block_14 = CodeBlock { "natural"; "coastline"; }
OSMData_3 = Elk.OSM.OSMData(OSM=location.OSM, File=location.XML, featureType=code_block_14.out0, subTypes=code_block_14.out1)

# group: roof
roof_types = RoofTypes("Roof_Pitched-50SS-220Ins-20MPan-225Purl")
byGeometry_3 = BoundingBox.ByGeometry(geom=extrudeAsSolid)
maxPoint = BoundingBox.MaxPoint(boundingBox=byGeometry_3)
Z = Point.Z(point=maxPoint)
byElevation = Level.ByElevation(elevation=Z)
byOutlineTypeAndLevel = Roof.ByOutlineTypeAndLevel(outline=byPoints_3, roofType=roof_types, level=byElevation)

# group: OSM water
code_block_15 = CodeBlock { "natural"; "water"; }
OSMData_4 = Elk.OSM.OSMData(OSM=location.OSM, File=location.XML, featureType=code_block_15.out0, subTypes=code_block_15.out1)
